# Grasshopper definition dev.ghx (Grasshopper 1.0.7)

panel = Panel("/Users/yoshionao_mbp/Documents/Digital_Artisan/Mesh_Vertex_Color")
button = Button()
python = GhPythonScript(PATH_MAC=panel, BOOL=Toggle(True))  # -> out
# ---------- python: Python ----------
import sys

if BOOL:
    sys.path.append(PATH_MAC)
    # sys.path.append(PATH_LAPTOP)    
    # sys.path.append(PATH_DESKTOP)

print(sys.path)
# ---------- end python ----------
python_2 = GhPythonScript()  # -> out, a
# ---------- python_2: Python ----------
import rhinoscriptsyntax as rs


# from mesh_vertex_color import operate_mesh
import mesh_vertex_color


# om = operate_mesh.Operate_Mesh()
# ---------- end python_2 ----------
panel_2 = Panel(python_2.out)
python_3 = GhPythonScript(NUM=Slider(20, range=0..100))  # -> out, POINTS, FACES
# ---------- python_3: Python ----------
import math
import rhinoscriptsyntax as rs

num = int(NUM) + 1



def define_mesh_points(num):
    
    pts = []
    
    for i in xrange(num):
        for j in xrange(num):
            
            yy = j * (math.sin(1/3 * math.pi))
            
            if j%2 == 0:
                xx = i
                pts.append(rs.AddPoint(xx, yy, 0))
            else:
                xx = i + (math.cos(1/3 * math.pi))
                pts.append(rs.AddPoint(xx, yy, 0))
            
    
    return pts


def define_mesh_faces(num):
    
    faces = []

    for i in xrange(num - 1):
        for j in xrange(num - 1):
            a = i * num + j
            b = (i+1) * num + j
            c = (i+1) * num + (j+1)
            d = i * num + (j+1)

            if j%2 == 0:
                face_id_a = "{};{};{};".format(a, b, d)
                face_str_a = "T{" + face_id_a +"}"
                
                face_id_b = "{};{};{};".format(b, c, d)
                face_str_b = "T{" + face_id_b +"}"
                
                faces.append(face_str_a)
                faces.append(face_str_b)
                
            else:
                face_id_a = "{};{};{};".format(a, b, c)
                face_str_a = "T{" + face_id_a +"}"
                
                face_id_b = "{};{};{};".format(a, c, d)
                face_str_b = "T{" + face_id_b +"}"
                
                faces.append(face_str_a)
                faces.append(face_str_b)
    
    return faces

POINTS = define_mesh_points(num)
FACES = define_mesh_faces(num)
# ---------- end python_3 ----------
panel_3 = Panel(python_3.FACES)
bbox = BoundingBox(Content=python_3.POINTS, Plane=PlaneXY(0, 0, 0), UnionBox=True)  # -> Box, Box_2
area = Area(Geometry=bbox.Box)  # -> Area, Centroid
panel_4 = Panel(python)
pt = ConstructPoint(XCoordinate=0, YCoordinate=0, ZCoordinate=0)
panel_5 = Panel(pt)
ln = Line(StartPoint=python_3.POINTS, EndPoint=pt)
dist = Distance(PointA=python_3.POINTS, PointB=area.Centroid)
panel_6 = Panel(dist)
bnd = Bounds(Numbers=dist)
lng = ListLength(List=python_3.POINTS)
pt_2 = Point(python_3.POINTS)
panel_7 = Panel(pt_2)
remap = RemapNumbers(Value=dist, Source=bnd, Target="0.0 to 5.0")  # -> Mapped, Clipped
hsv = ColourHSV(Alpha=1, Hue=remap.Mapped, Saturation=1, Value=1)
panel_8 = Panel(lng)
conmesh = ConstructMesh(Vertices=python_3.POINTS, Faces=python_3.FACES, Colours=hsv)
panel_9 = Panel(remap.Mapped)
panel_10 = Panel(python_3.POINTS)
medges = MeshEdges(Mesh=conmesh)  # -> NakedEdges, InteriorEdges, NonManifoldEdges
